# Grasshopper definition Hex to RGB 0-1.gh (Grasshopper 1.0.7)
# plug-ins: Human, MetaHopper, Wombat

panel = Panel("282828")
python = GhPythonScript(hex=panel)  # -> rgb, r, g, b
# ---------- python: Python ----------
__author__ = "runxel"
__version__ = "2020-05-02"

import rhinoscriptsyntax as rs


s = [char for char in hex]

_r = int( (s[0] + s[1]), 16)
_g = int( (s[2] + s[3]), 16)
_b = int( (s[4] + s[5]), 16)

_rgb = rs.CreateColor(_r, _g, _b)
# ---------- end python ----------

rectangle = Rectangle(Plane=PlaneXY(0, 0, 0), XSize="10", YSize="10", Radius=0)  # -> Rectangle, Length
boundary = BoundarySurfaces(Edges=rectangle.Rectangle)
previewmat = CustomPreviewMaterials(Geometry=boundary, DiffuseColor=python.rgb)

dom = ConstructDomain(DomainStart=0, DomainEnd=255)
remap = RemapNumbers(Value=python.r, Source=dom, Target=Domain(0, 1))  # -> Mapped, Clipped
remap_2 = RemapNumbers(Value=python.g, Source=dom, Target=Domain(0, 1))  # -> Mapped, Clipped
remap_3 = RemapNumbers(Value=python.b, Source=dom, Target=Domain(0, 1))  # -> Mapped, Clipped
python_2 = GhPythonScript(r=remap.Mapped, g=remap_2.Mapped, b=remap_3.Mapped)  # -> iterm
# ---------- python_2: Python ----------
# get a correct iTerm color theme dict out of it
_iterm = \
"<dict>\n" \
"\t<key>Alpha Component</key>\n" \
"\t<real>1</real>\n" \
"\t<key>Blue Component</key>\n" \
"\t<real>{}</real>\n" \
"\t<key>Green Component</key>\n" \
"\t<real>{}</real>\n" \
"\t<key>Red Component</key>\n" \
"\t<real>{}</real>\n" \
"</dict>".format(_b, _g, _r)
# ---------- end python_2 ----------
panel_2 = Panel(python_2)
panel_3 = Panel(remap.Mapped)
panel_4 = Panel(remap_2.Mapped)
panel_5 = Panel(remap_3.Mapped)
stream_file_data = Button()
path = FilePath("C:\Users\Lucas\Desktop\test.txt")
setpanel = SetPanelProperties(Panel=null, Color=python.rgb, AllObjects_Object=panel)
writetxt = WriteToTextFile(Run=stream_file_data, TextToWrite=panel_2, FilePath=path, Append=False, NewOnly=False)
